# Grasshopper definition ImageProcessor.gh (Grasshopper 1.0.8)

base_height = Slider(3, range=0..10)
subtraction = Subtraction(A=base_height, B=Slider(1, range=0..1))
series = Series(Start=Slider(0, range=0..10), Step=Slider(1, range=0..10), Count=base_height)
series_2 = Series(Start=subtraction, Step=Slider(1, range=0..10), Count=Slider(1, range=0..10))
construct_point = ConstructPoint(XCoordinate=0, YCoordinate=0, ZCoordinate=series)
construct_point_2 = ConstructPoint(XCoordinate=0, YCoordinate=0, ZCoordinate=series_2)
xy_plane = XYPlane(Origin=construct_point)
xy_plane_2 = XYPlane(Origin=construct_point_2)
width = Slider(50, range=0..100)
addition = Addition(A=width, B=Slider(1, range=0..1))
rectangle = Rectangle(Plane=xy_plane, XSize=addition, YSize=addition, Radius=0)  # -> Rectangle, Length
loft = Loft(
    Curves=rectangle.Rectangle,
    Options={Adjust=False, Closed=False, LoftEnds=0, LoftSimp=0, LoftType=0, Rebuild=10, Refit=0.01})
plane_surface = PlaneSurface(Plane=xy_plane_2, XSize=width, YSize=width)  # -> reparameterize(Plane)
cap_holes = CapHoles(Brep=loft)
uv_count = Slider(100, range=50..100)
upper_range = Slider(1.5, range=0..10)
lower_range = Slider(0.2, range=0..10)
divide_surface = DivideSurface(Surface=plane_surface, UCount=uv_count, VCount=uv_count)  # -> Points, Normals, Parameters
image_sampler = ImageSampler(divide_surface.Parameters, Filter="Colour", Interpolate=False, Umax=1, Umin=0, Vmax=1, Vmin=0, Wrap=1)
range_height_of_rectangles = ConstructDomain(DomainStart=upper_range, DomainEnd=lower_range)
panel = Panel(divide_surface.Parameters)
height_of_buildings_multiplier = Slider(3, range=1..10)
panel_2 = Panel(image_sampler)
remap_numbers = RemapNumbers(Value=image_sampler, Source=Domain(0, 1), Target=range_height_of_rectangles)  # -> Mapped, Clipped
rectangle_size = Slider(1, range=0..10)
panel_3 = Panel(remap_numbers.Mapped)
multiplication = Multiplication(A=remap_numbers.Mapped, B=height_of_buildings_multiplier)
rectangle_2 = Rectangle(Plane=divide_surface.Points, XSize=rectangle_size, YSize=rectangle_size, Radius=0)  # -> Rectangle, Length
unit_z = UnitZ(Factor=multiplication)
panel_4 = Panel(unit_z)
extrude = Extrude(Base=rectangle_2.Rectangle, Direction=unit_z)
panel_5 = Panel(extrude)
cap_holes_2 = CapHoles(Brep=extrude)
merge = Merge(Data1=cap_holes_2, Data2=cap_holes)
